# Grasshopper definition 00_import_.ghx (Grasshopper 1.0.7)

panel = Panel("/Users/marirena/Library/CloudStorage/GoogleDrive-marianthi.kladeftira@epfl.ch/My Drive/002_Workshops/DMS 2024/06_RobotFiles/txt/diffCheck.txt")

# ---- group: magenta_base_geometry
half_gap_between_elements = Slider(0.035, range=0..0.1)
small_section = Slider(0.08, range=0..0.1)
countx_grip = Slider(36, range=0..100)
county_grip = Slider(22, range=0..100)
ghpython_script = GhPythonScript(thickness=half_gap_between_elements, section=small_section, count_x=countx_grip, count_y=county_grip)  # -> out, rectangles, outline, grid; inputs count_x: Int32, count_y: Int32
# ---------- ghpython_script: Python ----------
import Rhino.Geometry as rg

rectangles = []
grid = []

for x in range(count_x):
    for y in range(count_y):
        px = thickness + 2*thickness*x + section*x
        py = thickness + 2*thickness*y + section*y
        p = rg.Point3d(px,py,0)
        pl = rg.Plane.WorldXY
        pl.Origin = p
        rec = rg.Rectangle3d(pl, section,section)
        rectangles.append(rec)
        
        brep = rg.Brep.CreatePlanarBreps(rec.ToNurbsCurve())[0]
    
        # Calculate the AreaMassProperties of the brep
        area_mass_props = rg.AreaMassProperties.Compute(brep)
    
        # Extract the centroid
        centroid = area_mass_props.Centroid
        grid.append(centroid)
        
outline = rg.Rectangle3d(rg.Plane.WorldXY, px + section + thickness, py + section + thickness)
# ---------- end ghpython_script ----------
surface = Surface(flatten(ghpython_script.rectangles))
surface_2 = Surface(ghpython_script.outline)
solid_difference = SolidDifference(BrepsA=surface_2, BrepsB=surface)
surface_3 = Surface(solid_difference)
unit_z = UnitZ(Factor=Slider(0.09, range=0..1))
surface_4 = Surface(ghpython_script.outline)
move = Move(Geometry=surface_4, Motion=expr("-x", unit_z))  # -> Geometry, Transform
unit_z_2 = UnitZ(Factor=Slider(0.25, range=0..1))
extrude = Extrude(Base=surface_3, Direction=expr("-x", unit_z))
extrude_2 = Extrude(Base=move.Geometry, Direction=expr("-x", unit_z_2))
cap_holes = CapHoles(Brep=extrude_2)
solid_union = SolidUnion(Breps=cap_holes)

# ----
original_state_2 = Box([{Plane=PlaneYZ(0.1941333333, 0.224, 0.1279998855), X=Domain(-0.012, 0.012), Y=Domain(-0.25, 0.25), Z=Domain(-0.012, 0.012)}, {Plane=PlaneYZ(0.07466666667, 0.3434666667, 0.1280003898), X=Domain(-0.012, 0.012), Y=Domain(-0.25, 0.25), Z=Domain(-0.012, 0.012)}, {Plane=PlaneYZ(0.1344, 0.2837333333, 0.1280001973), X=Domain(-0.012, 0.012), Y=Domain(-0.25, 0.25), Z=Domain(-0.012, 0.012)}, {Plane=Plane(origin=(0.1941333333, 0.2538666667, 0.1702689067), x=(0.8049174921, 0, -0.5933867464), y=(0.5933867464, 0, 0.8049174921)), X=Domain(-0.012, 0.012), Y=Domain(-0.25, 0.25), Z=Domain(-0.012, 0.012)}, {Plane=Plane(origin=(0.07466666667, 0.3136, 0.1418336), x=(-0.7024239868, 0, 0.7117587673), y=(-0.7117587673, 0, -0.7024239868)), X=Domain(-0.012, 0.012), Y=Domain(-0.25, 0.25), Z=Domain(-0.012, 0.012)}])
original_state_1 = Box([{Plane=PlaneYZ(0.1344, 0.2837333333, 0.1279997264), X=Domain(-0.012, 0.012), Y=Domain(-0.25, 0.25), Z=Domain(-0.012, 0.012)}, {Plane=PlaneYZ(0.07466666667, 0.3434666667, 0.1279995046), X=Domain(-0.012, 0.012), Y=Domain(-0.25, 0.25), Z=Domain(-0.012, 0.012)}, {Plane=Plane(origin=(0.07466666667, 0.3136, 0.13024064), x=(-0.7113629932, 0, 0.7028247946), y=(-0.7028247946, 0, -0.7113629932)), X=Domain(-0.012, 0.012), Y=Domain(-0.25, 0.25), Z=Domain(-0.012, 0.012)}])
ghpython_script_2 = GhPythonScript(previous_state=original_state_1, new_state=original_state_2, tolerance=Slider(0.045, range=0..0.1))  # -> out, new_breps, next_state_updated; inputs previous_state: list of Brep, new_state: list of Brep
# ---------- ghpython_script_2: Python ----------
import Rhino.Geometry as rg

new_breps = []
    
for new_brep in new_state:
    is_new = True
    
    # Get the centroid of the new Brep
    new_centroid = rg.AreaMassProperties.Compute(new_brep).Centroid

    for prev_brep in previous_state:
        # Get the centroid of the previous Brep
        prev_centroid = rg.AreaMassProperties.Compute(prev_brep).Centroid
        
        # Calculate the distance between the centroids
        distance = prev_centroid.DistanceTo(new_centroid)
        
        # Check if within tolerance
        if distance <= tolerance:
            # Brep is considered the same (within tolerance)
            is_new = False
            break
    
    if is_new:
        new_breps.append(new_brep)
        
next_state_updated = previous_state + new_breps
# ---------- end ghpython_script_2 ----------
original_state_3 = Box([{Plane=PlaneYZ(0.0448, 0.3434666667, 0.1280002929), X=Domain(-0.012, 0.012), Y=Domain(-0.25, 0.25), Z=Domain(-0.012, 0.012)}, {Plane=PlaneYZ(0.2837333333, 0.1344, 0.1279995362), X=Domain(-0.012, 0.012), Y=Domain(-0.25, 0.25), Z=Domain(-0.012, 0.012)}, {Plane=PlaneYZ(0.1344, 0.2837333333, 0.1280000638), X=Domain(-0.012, 0.012), Y=Domain(-0.25, 0.25), Z=Domain(-0.012, 0.012)}, {Plane=PlaneYZ(0.1941333333, 0.224, 0.12800011), X=Domain(-0.012, 0.012), Y=Domain(-0.25, 0.25), Z=Domain(-0.012, 0.012)}, {Plane=Plane(origin=(0.07466666667, 0.3136, 0.13408608), x=(0.7054775739, 0, -0.7087322433), y=(-0.7087322433, 0, -0.7054775739)), X=Domain(-0.012, 0.012), Y=Domain(-0.25, 0.25), Z=Domain(-0.012, 0.012)}, {Plane=Plane(origin=(0.1642666667, 0.2538666667, 0.1295380267), x=(-0.8040819484, 0, 0.5945184776), y=(0.5945184776, 0, 0.8040819484)), X=Domain(-0.012, 0.012), Y=Domain(-0.25, 0.25), Z=Domain(-0.012, 0.012)}, {Plane=Plane(origin=(0.2538666667, 0.1642666667, 0.16971584), x=(0.8505944918, 0, -0.5258222234), y=(-0.5258222234, 0, -0.8505944918)), X=Domain(-0.012, 0.012), Y=Domain(-0.25, 0.25), Z=Domain(-0.012, 0.012)}])
ghpython_script_3 = GhPythonScript(previous_state=ghpython_script_2.next_state_updated, new_state=original_state_3, tolerance=Slider(0.045, range=0..0.1))  # -> out, new_breps, next_state_updated; inputs previous_state: list of Brep, new_state: list of Brep; same code as ghpython_script_2
ghpython_script_4 = GhPythonScript(file_path=panel, width=Slider(0.08, range=0..0.1))  # -> out, boxes, lines
# ---------- ghpython_script_4: Python ----------
import Rhino.Geometry as rg

with open(file_path, 'r') as file:
    txt_lines = file.readlines()

boxes = []
origin = []
x_axis = []
y_axis = []
length = []
lines = []

for line in txt_lines:
    if line.strip() and not line.startswith('----------'):
        parts = list(map(float, line.split()))
        if len(parts) == 6:
            p1 = rg.Point3d(*parts[:3])
            p2 = rg.Point3d(*parts[3:6])
            lines.append(rg.Line(p1,p2))
            length.append(p1.DistanceTo(p2))
            origin.append( 0.5 * (p1 + p2) )
            xaxis = p2 - p1
            x_axis.append(xaxis)
        elif len(parts) == 3:
            yaxis = rg.Vector3d(*parts[:])
            y_axis.append( yaxis )
            
for o,x,y,l in zip(origin,x_axis,y_axis,length):
    
    pl = rg.Plane(o, x, y)
    box = rg.Box(pl, 
        rg.Interval(-0.5*l,0.5*l),
        rg.Interval(-0.5*width,0.5*width), 
        rg.Interval(-0.5*width,0.5*width))
    boxes.append(box)
# ---------- end ghpython_script_4 ----------
state_1 = Box([{Plane=PlaneYZ(0.1344, 0.2837333333, 0.1279997264), X=Domain(-0.012, 0.012), Y=Domain(-0.25, 0.25), Z=Domain(-0.012, 0.012)}, {Plane=PlaneYZ(0.07466666667, 0.3434666667, 0.1279995046), X=Domain(-0.012, 0.012), Y=Domain(-0.25, 0.25), Z=Domain(-0.012, 0.012)}, {Plane=Plane(origin=(0.07466666667, 0.3136, 0.13024064), x=(-0.7113629932, 0, 0.7028247946), y=(-0.7028247946, 0, -0.7113629932)), X=Domain(-0.012, 0.012), Y=Domain(-0.25, 0.25), Z=Domain(-0.012, 0.012)}])
state_3_new_breps = Brep([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])
state_2_new_breps = Brep([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])
geometry = Geometry(ghpython_script.outline)
original_boxes = Box(ghpython_script_4.boxes)
scale = Scale(Geometry=geometry, Center=Point(0, 0, 0), Factor=Slider(10, range=10..1000))  # -> Geometry, Transform
panel_2 = Panel(ghpython_script_4.boxes)

bounding_box = BoundingBox(Content=original_boxes, Plane=PlaneXY(0, 0, 0), UnionBox=True)  # -> Box, Box_2
deconstruct_brep = DeconstructBrep(Brep=bounding_box.Box)  # -> Faces, Edges, Vertices
list_item = ListItem(List=deconstruct_brep.Vertices, Index=0, Wrap=True)
negative = Negative(Value=list_item)
move_2 = Move(Geometry=original_boxes, Motion=negative)  # -> Geometry, Transform

panel_3 = Panel(scale.Geometry)

# ---- group: scaling factor to get rid of gap
addition = Addition(Half_gap=half_gap_between_elements, Section=small_section, Half_gap_2=half_gap_between_elements)
section = Data(small_section)
division = Division(A=section, B=addition)
panel_4 = Panel(division)

# ----
deconstruct_brep_2 = DeconstructBrep(Brep=move_2.Geometry)  # -> Faces, Edges, Vertices
area = Area(Geometry=move_2.Geometry)  # -> Area, Centroid
length = Length(Curve=deconstruct_brep_2.Edges)
sort_list = SortList(Keys=length, ValuesValuesA=deconstruct_brep_2.Edges)  # -> Keys, ValuesValuesA
list_item_2 = ListItem(List=sort_list.ValuesValuesA, Index="-1", Wrap=True)  # -> flatten(Item)
list_item_3 = ListItem(List=sort_list.ValuesValuesA, Index="6", Wrap=True)  # -> flatten(Item)
construct_plane = ConstructPlane(Origin=area.Centroid, XAxis=list_item_3, YAxis=list_item_2)

# ---- group: snap to grid + apply scale
ghpython_script_5 = GhPythonScript(input_plane=construct_plane, points=ghpython_script.grid, grid=ghpython_script.grid, sc_factor=division)  # -> out, a, new_grid; inputs input_plane: Plane, points: list of Point3d, grid: list of Point3d
# ---------- ghpython_script_5: Python ----------
import Rhino.Geometry as rg
import math


new_grid = []

for pt in grid: 
    xform = rg.Transform.Scale(rg.Point3d(0,0,0), sc_factor)
    pt.Transform(xform)
    new_grid.append(pt)


#snap origin to grid
min_squared_distance = float("inf")
for i, point in enumerate(points):
    squared_distance = (point.X - input_plane.Origin.X) ** 2 + (point.Y - input_plane.Origin.Y) ** 2
    if squared_distance < min_squared_distance:
        min_squared_distance = squared_distance
        closest_point = new_grid[i]

input_plane.Origin = rg.Point3d(closest_point.X, closest_point.Y, input_plane.Origin.Z)

a = input_plane
# ---------- end ghpython_script_5 ----------

# ----
tree_statistics = TreeStatistics(Tree=ghpython_script_5.new_grid)  # -> Paths, Length, Count
list_item_4 = ListItem(List=tree_statistics.Paths, Index=0, Wrap=True)
plane = Plane(ghpython_script_5.a)
tree_branch = TreeBranch(Tree=ghpython_script_5.new_grid, Path=list_item_4, MaintainPaths=True)  # -> flatten(Branch)
length_2 = Length(Curve=list_item_2)
number_slider = Slider(0.14, range=0..1)
number_slider_2 = Slider(31, range=0..100)
panel_5 = Panel("(2, 39.760887466288636, 89.386346970721249, 0.61365302927875953)")
thickness = Data(half_gap_between_elements)
section_2 = Data(small_section)
division_2 = Division(A=section_2, B=2)

# ---- group: Fix orientation
ghpython_script_6 = GhPythonScript(
    thickness=half_gap_between_elements,
    planes=plane,
    threshold=number_slider_2,
    lengths=length_2,
    grid=ghpython_script.grid,
    section=small_section)  # -> out, vertical, Y, X, v_lengths, x_lengths, y_lengths; inputs planes: list of Plane, lengths: list, grid: list of Point3d
# ---------- ghpython_script_6: Python ----------
import Rhino.Geometry as rg
import math

vertical = []
X = []
Y = []

v_lengths = []
x_lengths = []
y_lengths = []


def find_minimum_with_index(a, b, c):
    numbers = [a, b, c]
    min_value = min(numbers)
    min_index = numbers.index(min_value)
    return min_index

def which_axis_is_closer(plane):
    
    angle_z = rg.Vector3d.VectorAngle(pl.YAxis, rg.Vector3d.ZAxis)
    angle_minusz = rg.Vector3d.VectorAngle(pl.YAxis, -rg.Vector3d.ZAxis)
    minz = min(angle_z, angle_minusz)
    #projected yaxis
    angle_y = rg.Vector3d.VectorAngle(rg.Vector3d(pl.YAxis.X, pl.YAxis.Y,0), rg.Vector3d.YAxis)
    angle_minusy = rg.Vector3d.VectorAngle(rg.Vector3d(pl.YAxis.X, pl.YAxis.Y,0), -rg.Vector3d.YAxis)
    miny = min(angle_y, angle_minusy)
    #projected x axis
    angle_x = rg.Vector3d.VectorAngle(rg.Vector3d(pl.YAxis.X, pl.YAxis.Y,0), rg.Vector3d.XAxis)
    angle_minusx = rg.Vector3d.VectorAngle(rg.Vector3d(pl.YAxis.X, pl.YAxis.Y,0), -rg.Vector3d.XAxis)
    minx = min(angle_x, angle_minusx)
    
    return find_minimum_with_index(minz, miny, minx), math.degrees(minz), math.degrees(miny), math.degrees(minx), math.degrees(angle_x), math.degrees(angle_minusx)

#align elements with world_axes

for i,pl in enumerate(planes):
    if i==11:
        print which_axis_is_closer(pl)
    #check if the longest side is close to worldZ or -WorldZ, so if it's aligned with z (vertical)
    if which_axis_is_closer(pl)[0] == 0:
        plane = rg.Plane.WorldYZ
        #fix so that they are flash to the ground
        plane.Origin = rg.Point3d(pl.Origin.X, pl.Origin.Y, lengths[i]/2)
        vertical.append(plane)
        v_lengths.append(lengths[i])
        
    #chech if the longest side is close to worldY or -WorldY (Y aligned - hor)
    elif which_axis_is_closer(pl)[0] == 1:
        #make all planes the same
        if rg.Vector3d.VectorAngle(pl.XAxis, rg.Vector3d.XAxis) < math.radians(threshold) or rg.Vector3d.VectorAngle(pl.XAxis, -rg.Vector3d.XAxis)<math.radians(threshold):
            pl.XAxis = pl.ZAxis
        #check if it's horizontal
        if rg.Vector3d.VectorAngle(pl.YAxis, rg.Vector3d.YAxis) < math.radians(10) or rg.Vector3d.VectorAngle(pl.YAxis, -rg.Vector3d.YAxis) < math.radians(10):
            origin = pl.Origin
            pl = rg.Plane.WorldXY
            pl.Origin = rg.Point3d(origin.X, origin.Y, (origin.Z //(section+ 2*thickness))* (section) + 0.5 * section)
        else:
            #force x component to be 0
            xaxis = rg.Vector3d( 0, pl.XAxis.Y, pl.XAxis.Z)
            yaxis = rg.Vector3d( 0, pl.YAxis.Y, pl.YAxis.Z)
            pl = rg.Plane(pl.Origin, xaxis, yaxis)
        Y.append(pl)
        y_lengths.append(lengths[i])
        
    #chech if the longest side is close to worldX or -WorldX (X aligned - hor)
    else:
        #make all planes the same
        if rg.Vector3d.VectorAngle(pl.XAxis, rg.Vector3d.YAxis) < math.radians(threshold) or rg.Vector3d.VectorAngle(pl.XAxis, -rg.Vector3d.YAxis)<math.radians(threshold):
            pl.XAxis = pl.ZAxis
        #check if it's horizontal
        if rg.Vector3d.VectorAngle(pl.YAxis, rg.Vector3d.XAxis) < math.radians(10) or rg.Vector3d.VectorAngle(pl.YAxis, -rg.Vector3d.XAxis) < math.radians(10):
            origin = pl.Origin
            pl = rg.Plane.WorldXY
            pl.Rotate (math.radians(90), rg.Vector3d.ZAxis, pl.Origin)
            pl.Origin = rg.Point3d(origin.X, origin.Y, (origin.Z //(section+ 2*thickness))*(section) + 0.5 * section)
        else:
            #force y component to be 0
            xaxis = rg.Vector3d( pl.XAxis.X, 0, pl.XAxis.Z)
            yaxis = rg.Vector3d( pl.YAxis.X, 0, pl.YAxis.Z)
            pl = rg.Plane(pl.Origin, xaxis, yaxis)
        X.append(pl)
        x_lengths.append(lengths[i])
# ---------- end ghpython_script_6 ----------

# ----
panel_6 = Panel(ghpython_script_6.out)

# ---- group: tentative
ghpython_script_7 = GhPythonScript(
    thickness=half_gap_between_elements,
    planes=plane,
    threshold=number_slider_2,
    lengths=length_2,
    grid=ghpython_script.grid,
    section=small_section,
    sc_factor=division,
    z_tolerance=Slider(10, range=0..90))  # -> out, vertical, Y, X, v_lengths, x_lengths, y_lengths; inputs planes: list of Plane, lengths: list, grid: list of Point3d
# ---------- ghpython_script_7: Python ----------
import Rhino.Geometry as rg
import math

vertical = []
X = []
Y = []

v_lengths = []
x_lengths = []
y_lengths = []






def find_maximum_with_index(a, b, c):
    numbers = [a, b, c]
    max_value = max(numbers)
    max_index = numbers.index(max_value)
    return max_index



def closest_aligned_axis(pl):

    # Compute dot products with world axes
    dot_x = abs(rg.Vector3d.Multiply(rg.Vector3d.XAxis, pl.YAxis))  
    dot_y = abs(rg.Vector3d.Multiply(rg.Vector3d.YAxis, pl.YAxis)) 
    dot_z = abs(rg.Vector3d.Multiply(rg.Vector3d.ZAxis, pl.YAxis)) 
    
    # Calculate the angle between the box's Y-axis and the world Z-axis in degrees
    angle_to_z = math.degrees(math.acos(dot_z))
    
    # Determine the closest aligned axis according to tolerance
    if angle_to_z <= z_tolerance: 
        closest_axis=0
    elif dot_x >= dot_y:
        closest_axis=2
    else:
        closest_axis=1

    return closest_axis



#align elements with world_axes

for i,pl in enumerate(planes):
    closest_axis = closest_aligned_axis(pl)

    #check if the longest side is close to worldZ or -WorldZ, so if it's aligned with z (vertical)
    if closest_axis== 0:
        plane = rg.Plane.WorldYZ
        #fix so that they are flash to the ground
        plane.Origin = rg.Point3d(pl.Origin.X, pl.Origin.Y, lengths[i]/2)
        vertical.append(plane)
        v_lengths.append(lengths[i])
        
    #chech if the longest side is close to worldY or -WorldY (Y aligned - hor)
    elif closest_axis== 1:
        #make all planes the same
        if rg.Vector3d.VectorAngle(pl.XAxis, rg.Vector3d.XAxis) < math.radians(threshold) or rg.Vector3d.VectorAngle(pl.XAxis, -rg.Vector3d.XAxis)<math.radians(threshold):
            pl.XAxis = pl.ZAxis
        #check if it's horizontal
        if rg.Vector3d.VectorAngle(pl.YAxis, rg.Vector3d.YAxis) < math.radians(10) or rg.Vector3d.VectorAngle(pl.YAxis, -rg.Vector3d.YAxis) < math.radians(10):
            origin = pl.Origin
            pl = rg.Plane.WorldXY
            pl.Origin = rg.Point3d(origin.X, origin.Y, (origin.Z //(section+ 2*thickness))* (section) + 0.5 * section)
        else:
            #force x component to be 0
            xaxis = rg.Vector3d( 0, pl.XAxis.Y, pl.XAxis.Z)
            yaxis = rg.Vector3d( 0, pl.YAxis.Y, pl.YAxis.Z)
            pl = rg.Plane(pl.Origin, xaxis, yaxis)
        Y.append(pl)
        y_lengths.append(lengths[i])
        
    #chech if the longest side is close to worldX or -WorldX (X aligned - hor)
    else:
        #make all planes the same
        if rg.Vector3d.VectorAngle(pl.XAxis, rg.Vector3d.YAxis) < math.radians(threshold) or rg.Vector3d.VectorAngle(pl.XAxis, -rg.Vector3d.YAxis)<math.radians(threshold):
            pl.XAxis = pl.ZAxis
        #check if it's horizontal
        if rg.Vector3d.VectorAngle(pl.YAxis, rg.Vector3d.XAxis) < math.radians(10) or rg.Vector3d.VectorAngle(pl.YAxis, -rg.Vector3d.XAxis) < math.radians(10):
            origin = pl.Origin
            pl = rg.Plane.WorldXY
            pl.Rotate (math.radians(90), rg.Vector3d.ZAxis, pl.Origin)
            pl.Origin = rg.Point3d(origin.X, origin.Y, (origin.Z //(section+ 2*thickness))*(section) + 0.5 * section)
        else:
            #force y component to be 0
            xaxis = rg.Vector3d( pl.XAxis.X, 0, pl.XAxis.Z)
            yaxis = rg.Vector3d( pl.YAxis.X, 0, pl.YAxis.Z)
            pl = rg.Plane(pl.Origin, xaxis, yaxis)
        X.append(pl)
        x_lengths.append(lengths[i])
# ---------- end ghpython_script_7 ----------
center_box = CenterBox(
    Base=[ghpython_script_7.vertical, ghpython_script_7.Y, ghpython_script_7.X],
    X=division_2,
    Y=expr("0.5*x", ghpython_script_6.v_lengths),
    Z=division_2)

# ----
multiplication = Multiplication(A=thickness, B=2)
addition_2 = Addition(A=division_2, B=thickness)
center_box_2 = CenterBox(Base=ghpython_script_6.X, X=division_2, Y=expr("0.5*x", ghpython_script_6.x_lengths), Z=division_2)
center_box_3 = CenterBox(Base=ghpython_script_6.vertical, X=division_2, Y=expr("0.5*x", ghpython_script_6.v_lengths), Z=division_2)
center_box_4 = CenterBox(Base=ghpython_script_6.Y, X=division_2, Y=expr("0.5*x", ghpython_script_6.y_lengths), Z=division_2)
merge = Merge(Data1=ghpython_script_6.vertical, Data2=ghpython_script_6.X, Data3=ghpython_script_6.Y)
merge_2 = Merge(Data1=ghpython_script_6.v_lengths, Data2=ghpython_script_6.x_lengths, Data3=ghpython_script_6.y_lengths)
panel_7 = Panel(merge)
geometry_2 = Geometry([center_box_3, center_box_4, center_box_2])
custom_preview = CustomPreview(Geometry=center_box_3, Material=ColourSwatch(SwatchColor=RGB(255, 229, 0)))
custom_preview_2 = CustomPreview(Geometry=center_box_4, Material=ColourSwatch(SwatchColor=RGB(255, 48, 210)))
custom_preview_3 = CustomPreview(Geometry=center_box_2, Material=ColourSwatch(SwatchColor=RGB(48, 255, 224)))
wood_section = Slider(0.24, range=0..1)

# ---- group: scaling factor to get rid of gap
tolerance = Slider(0.002, range=0..0.005)
section_3 = Data(small_section)
addition_3 = Addition(A=wood_section, B=tolerance)
division_3 = Division(A=addition_3, B=section_3)
scale_2 = Scale(Geometry=tree_branch, Center=Point(0, 0, 0), Factor=division_3)  # -> Geometry, Transform
panel_8 = Panel(division_3)
rectangle = Rectangle(Plane=scale_2.Geometry, XSize=Domain(-0.12, 0.12), YSize=Domain(-0.12, 0.12), Radius=0)  # -> Rectangle, Length

# ----
merge_3 = Merge(Data1=ghpython_script_6.vertical, Data2=ghpython_script_6.Y, Data3=ghpython_script_6.X)
scale_3 = Scale(Geometry=merge_3, Center=Point(0, 0, 0), Factor=division_3)  # -> Geometry, Transform
length_3 = Number(merge_2)
ghpython_script_8 = GhPythonScript(l=length_3)  # -> out, a
# ---------- ghpython_script_8: Python ----------
if l < 1.8:
    a = 5
else:
    a = 10
# ---------- end ghpython_script_8 ----------
center_box_5 = CenterBox(Base=scale_3.Geometry, X=expr("x/2", wood_section), Y=expr("0.5*x", ghpython_script_8.a), Z=expr("x/2", wood_section))
list_length = ListLength(List=ghpython_script_6.vertical)
split_list = SplitList(List=center_box_5, Index=list_length)  # -> ListA, ListB
ghpython_script_9 = GhPythonScript(vertical=split_list.ListA, non_v=split_list.ListB)  # -> moved_elements; inputs vertical: list of Brep, non_v: list of Brep
# ---------- ghpython_script_9: Python ----------
__author__ = "marirena"

import rhinoscriptsyntax as rs
import Rhino.Geometry as rg


def move_breps_to_xy_plane(boxes):
    moved_breps = []
    max_move = 0
    
    for b in vertical:
        
        bounding_box = b.GetBoundingBox(True)
        
        # Get the minimum point of the bounding box (this point will be on the XY plane after the move)
        min_z = bounding_box.Min.Z
        
        
        translation_vector = rg.Vector3d(0, 0, -min_z)
        moved_box = b.Duplicate()
        moved_box.Translate(translation_vector)
        
        # Add the moved box to the list
        moved_breps.append(moved_box)
        
        if abs(min_z) > max_move:
            max_move = abs(min_z)
    
    return moved_breps, max_move



moved_breps, move_rest = move_breps_to_xy_plane(vertical)


translation_rest = rg.Vector3d(0, 0, move_rest)

moved_other_breps = []

for other_b in non_v:
    moved_other_b = other_b.Duplicate()
    moved_other_b.Translate(translation_rest)
    moved_other_breps.append(moved_other_b)

moved_elements= moved_breps + moved_other_breps
# ---------- end ghpython_script_9 ----------

geometry_3 = Geometry(ghpython_script_9)
